# Grasshopper definition 01-patron.gh (Grasshopper 1.0.8)

puntos = Point([Point(0, 10, 0), Point(5, 10, 0), Point(10, 10, 0), Point(15, 10, 0), Point(20, 10, 0), Point(25, 10, 0), Point(30, 10, 0), Point(35, 10, 0), Point(40, 10, 0), Point(45, 10, 0), Point(50, 10, 0), Point(55, 10, 0), Point(60, 10, 0)])
patrón = Panel("""1
0
0""")
# se aplica el filtro
cull = CullPattern(List=puntos, CullPattern=patrón)
lista_para_filtrar = Panel(puntos)
puntos_filtrados = Point(cull)
lista_filtrada = Panel(cull)
