# Grasshopper definition toroide.gh (Grasshopper 1.0.8)

radio_exterior = Slider(15, range=0..20)
radio_interior = Slider(5.4, range=0..20)
radio_exterior_2 = Number(radio_exterior)
radio_interior_2 = Number(radio_interior)
radio_exterior_3 = Number(radio_exterior_2)
radio_interior_3 = Number(radio_interior_2)
radio_exterior_4 = Number(radio_exterior_2)
radio_interior_4 = Number(radio_interior_2)
# Centro de la sección
expression = Expression(x=radio_interior_3, y=radio_exterior_3, Expression="(x + y) / 2")
# Radio de la sección
expression_2 = Expression(x=radio_interior_4, y=radio_exterior_4, Expression="(x - y) / 2")
x_centro = Number(expression)
radio_de_la_sección = Number(expression_2)
pt = ConstructPoint(XCoordinate=x_centro, YCoordinate=0, ZCoordinate=0)
panel = Panel(radio_de_la_sección)
centro = Point(pt)
centro_2 = Point(centro)
Z = UnitZ(Factor=1)
radio_de_la_sección_2 = Number(radio_de_la_sección)
# Eje de revolución
origen = Point(Point(0, 0, 0))
xz = XZPlane(Origin=centro_2)
line = LineSDL(Start=origen, Direction=Z, Length=1)
# Sección
cir = Circle(Plane=xz, Radius=radio_de_la_sección_2)
eje_de_revolución = Line(line)
sección = Circle(cir)
eje_de_revolución_2 = Line(eje_de_revolución)
sección_2 = Circle(sección)
# Toroide
revsrf = Revolution(Curve=sección_2, Axis=eje_de_revolución_2, Domain=Domain(0, 6.283185307))
toroide = Surface(revsrf)
